# Grasshopper definition 01_quad_mesh_data.gh (Grasshopper 1.0.7)

# compas_singular
# Quad mesh data
# Robin Oval
# rpho2@cam.ac.uk
# https://github.com/BlockResearchGroup/compas_singular
mesh = Mesh(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)

mesh_2 = Mesh(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)
pt = Point([Point(1, 9, 0), Point(1, 1, 0), Point(9, 1, 0), Point(9, 9, 0)])

fromrhinomesh = FromRhinoMesh(mesh_guid=mesh)  # -> mesh; inputs poles: list
# ---------- fromrhinomesh: Python ----------
from compas_singular.rhino.grasshopper import gh_from_rhino_mesh
mesh = gh_from_rhino_mesh(mesh_guid, poles)
# ---------- end fromrhinomesh ----------
fromrhinomesh_2 = FromRhinoMesh(mesh_guid=mesh_2, poles=pt)  # -> mesh; inputs poles: list; same code as fromrhinomesh
quadmesh = QuadMesh(fromrhinomesh)
torhinomesh = ToRhinoMesh(mesh=quadmesh)  # -> mesh_guid
# ---------- torhinomesh: Python ----------
from compas_singular.rhino.grasshopper import gh_to_rhino_mesh
mesh_guid = gh_to_rhino_mesh(mesh)
# ---------- end torhinomesh ----------
vertices = MeshVertices(mesh=fromrhinomesh)  # -> vertex_coordinates, vertex_normals, vertex_areas
# ---------- vertices: Python ----------
from compas_singular.rhino.grasshopper import gh_mesh_vertices
vertex_coordinates, vertex_normals, vertex_areas = gh_mesh_vertices(mesh)
# ---------- end vertices ----------
faces = MeshFaces(mesh=fromrhinomesh)  # -> face_vertices, face_polylines, face_normals, face_areas
# ---------- faces: Python ----------
from compas_singular.rhino.grasshopper import gh_mesh_faces
face_vertices, face_polylines, face_normals, face_areas = gh_mesh_faces(mesh)
# ---------- end faces ----------
edges = MeshEdges(mesh=fromrhinomesh)  # -> edge_vertices, edge_lines
# ---------- edges: Python ----------
from compas_singular.rhino.grasshopper import gh_mesh_edges
edge_vertices, edge_lines = gh_mesh_edges(mesh)
# ---------- end edges ----------
singularities = QuadMeshSingularities(quad_mesh=fromrhinomesh)  # -> singularity_indices, singularity_coordinates
# ---------- singularities: Python ----------
from compas_singular.rhino.grasshopper import gh_quad_mesh_singularities
singularity_indices, singularity_coordinates = gh_quad_mesh_singularities(quad_mesh)
# ---------- end singularities ----------
polyedges = QuadMeshPolyedges(quad_mesh=fromrhinomesh)  # -> polyedge_vertices, polyedge_polylines, polyedge_closed
# ---------- polyedges: Python ----------
from compas_singular.rhino.grasshopper import gh_quad_mesh_polyedges
polyedge_vertices, polyedge_polylines, polyedge_closed = gh_quad_mesh_polyedges(quad_mesh)
# ---------- end polyedges ----------
strips = QuadMeshStrips(quad_mesh=fromrhinomesh)  # -> strip_edges, strip_lines, strip_closed
# ---------- strips: Python ----------
from compas_singular.rhino.grasshopper import gh_quad_mesh_strips
strip_edges, strip_lines, strip_closed = gh_quad_mesh_strips(quad_mesh)
# ---------- end strips ----------
crv = Curve(flatten(faces.face_polylines))
line = Line(flatten(edges.edge_lines))
mesh_3 = Mesh(torhinomesh)
points = PointList(Points=vertices.vertex_coordinates, Size=0.2)
trim = TrimTree(Tree=strips.strip_lines, Depth=1)
item = ListItem(List=vertices.vertex_coordinates, Index=polyedges.polyedge_vertices, Wrap=True)
intersection = SetIntersection(SetA=polyedges.polyedge_vertices, SetB=singularities.singularity_indices)  # -> simplify(Union)
pt_2 = Point(singularities.singularity_coordinates)
curvepoint = PointOnCurve(trim, parameter=0.5)
pline = PolyLine(Vertices=item, Closed=polyedges.polyedge_closed)
lng = ListLength(List=intersection)
dispatch = Dispatch(List=flatten(pline), DispatchPattern=flatten(lng))  # -> ListA, ListB
pline_2 = PolyLine(Vertices=curvepoint, Closed=strips.strip_closed)
crv_2 = Curve(dispatch.ListA)
crv_3 = Curve(pline_2)
branch = TreeBranch(Tree=edges.edge_vertices, Path=Slider(65, range=0..100), MaintainPaths=True)
item_2 = ListItem(List=branch, Index=0, Wrap=True)  # -> Item, Item1
collect = CollectEdgeElements(quad_mesh=fromrhinomesh, u=item_2.Item, v=item_2.Item1)  # -> strip_edges, strip_lines, polyedge_edges, polyedge_lines
# ---------- collect: Python ----------
from compas_singular.rhino.grasshopper import gh_get_quad_mesh_edge_elements
strip_edges, strip_lines, polyedge_edges, polyedge_lines = gh_get_quad_mesh_edge_elements(quad_mesh, u, v)
# ---------- end collect ----------
boundaryelements = BoundaryElements(mesh=fromrhinomesh)  # -> vertex_on_boundary, face_on_boundary, edge_on_boundary
# ---------- boundaryelements: Python ----------
from compas_singular.rhino.grasshopper import gh_mesh_is_element_on_boundary
vertex_on_boundary, face_on_boundary, edge_on_boundary = gh_mesh_is_element_on_boundary(mesh)
# ---------- end boundaryelements ----------
join = JoinCurves(Curves=collect.polyedge_lines, Preserve=False)
geo = Geometry(collect.strip_lines)
dispatch_2 = Dispatch(List=vertices.vertex_coordinates, DispatchPattern=boundaryelements.vertex_on_boundary)  # -> ListA, ListB
dispatch_3 = Dispatch(List=crv, DispatchPattern=boundaryelements.face_on_boundary)  # -> ListA, ListB
dispatch_4 = Dispatch(List=line, DispatchPattern=boundaryelements.edge_on_boundary)  # -> ListA, ListB
geo_2 = Geometry(join)
pt_3 = Point(dispatch_2.ListA)
crv_4 = Curve(dispatch_3.ListA)
crv_5 = Curve(dispatch_4.ListA)
