# Grasshopper definition 02_quad_mesh_densification_and_patterning.gh (Grasshopper 1.0.7)

# compas_singular
# Quad mesh densification and patterning
# Robin Oval
# rpho2@cam.ac.uk
# https://github.com/BlockResearchGroup/compas_singular
mesh = Mesh(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)
fromrhinomesh = FromRhinoMesh(mesh_guid=mesh)  # -> mesh; inputs poles: list
# ---------- fromrhinomesh: Python ----------
from compas_singular.rhino.grasshopper import gh_from_rhino_mesh
mesh = gh_from_rhino_mesh(mesh_guid, poles)
# ---------- end fromrhinomesh ----------
coarsen = CoarsenQuadMesh(quad_mesh=fromrhinomesh)  # -> coarse_quad_mesh
# ---------- coarsen: Python ----------
from compas_singular.rhino.grasshopper import gh_coarsening
coarse_quad_mesh = gh_coarsening(quad_mesh)
# ---------- end coarsen ----------
strips = QuadMeshStrips(quad_mesh=coarsen)  # -> strip_edges, strip_lines, strip_closed
# ---------- strips: Python ----------
from compas_singular.rhino.grasshopper import gh_quad_mesh_strips
strip_edges, strip_lines, strip_closed = gh_quad_mesh_strips(quad_mesh)
# ---------- end strips ----------
trim = TrimTree(Tree=strips.strip_lines, Depth=1)

target_length = Slider(1.2, range=0..2)
min_subdivision = Slider(1, range=0..10)

len = Length(Curve=trim)
avr = Average(Input=len)
division = Division(A=avr, B=target_length)
max = Maximum(A=division, B=min_subdivision)  # -> flatten(Result)
srf = Surface(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)
densify = DensifyQuadMesh(quad_mesh=coarsen, strips_subdivision=max)  # -> dense_quad_mesh; inputs strips_subdivision: list of Int32
# ---------- densify: Python ----------
from compas_singular.rhino.grasshopper import gh_densifiying
dense_quad_mesh = gh_densifiying(quad_mesh, strips_subdivision)
# ---------- end densify ----------
quadmesh = QuadMesh(densify)
boundaryelements = BoundaryElements(mesh=quadmesh)  # -> vertex_on_boundary, face_on_boundary, edge_on_boundary
# ---------- boundaryelements: Python ----------
from compas_singular.rhino.grasshopper import gh_mesh_is_element_on_boundary
vertex_on_boundary, face_on_boundary, edge_on_boundary = gh_mesh_is_element_on_boundary(mesh)
# ---------- end boundaryelements ----------
vertices = MeshVertices(mesh=quadmesh)  # -> vertex_coordinates, vertex_normals, vertex_areas
# ---------- vertices: Python ----------
from compas_singular.rhino.grasshopper import gh_mesh_vertices
vertex_coordinates, vertex_normals, vertex_areas = gh_mesh_vertices(mesh)
# ---------- end vertices ----------
lng = ListLength(List=vertices.vertex_coordinates)
debrep = DeconstructBrep(Brep=srf)  # -> Faces, Edges, Vertices

k = Slider(10, range=0..100)
d = Slider(0.5, range=0..1)

series = Series(Start=0, Step=1, Count=lng)
dispatch = Dispatch(List=series, DispatchPattern=boundaryelements.vertex_on_boundary)  # -> ListA, ListB
lng_2 = ListLength(List=dispatch.ListA)
repeat = RepeatData(Data=debrep.Edges, Length=lng_2)
cstrsmoothing = ConstrainedLaplacianSmoothing(mesh=densify, k=k, d=d, vertex_keys=dispatch.ListA, guid_constraints=repeat)  # -> smooth_mesh; inputs k: Int32, vertex_keys: list, guid_constraints: list
# ---------- cstrsmoothing: Python ----------
from compas_singular.rhino.grasshopper import gh_constrained_smoothing
smooth_mesh = gh_constrained_smoothing(mesh, k, d, vertex_keys, guid_constraints)
# ---------- end cstrsmoothing ----------
list = ValueList({"seed", "dual", "join", "ambo", "kis", "needle", "zip", "truncate", "ortho", "expand", "gyro", "snub", "meta", "bevel"}, selected="gyro")
conway = ConwayOperator(mesh=cstrsmoothing, operator=list)  # -> polygonal_mesh
# ---------- conway: Python ----------
from compas_singular.rhino.grasshopper import gh_conway
polygonal_mesh = gh_conway(mesh, operator)
# ---------- end conway ----------
quadmesh_2 = QuadMesh(conway)
vertices_2 = MeshVertices(mesh=quadmesh_2)  # -> vertex_coordinates, vertex_normals, vertex_areas; same code as vertices
boundaryelements_2 = BoundaryElements(mesh=quadmesh_2)  # -> vertex_on_boundary, face_on_boundary, edge_on_boundary; same code as boundaryelements
lng_3 = ListLength(List=vertices_2.vertex_coordinates)

k_2 = Slider(5, range=0..100)
d_2 = Slider(0.5, range=0..1)

series_2 = Series(Start=0, Step=1, Count=lng_3)
dispatch_2 = Dispatch(List=series_2, DispatchPattern=boundaryelements_2.vertex_on_boundary)  # -> ListA, ListB
lng_4 = ListLength(List=dispatch_2.ListA)
repeat_2 = RepeatData(Data=debrep.Edges, Length=lng_4)
cstrsmoothing_2 = ConstrainedLaplacianSmoothing(mesh=conway, k=k_2, d=d_2, vertex_keys=dispatch_2.ListA, guid_constraints=repeat_2)  # -> smooth_mesh; inputs k: Int32, vertex_keys: list, guid_constraints: list; same code as cstrsmoothing
edges = MeshEdges(mesh=cstrsmoothing_2)  # -> edge_vertices, edge_lines
# ---------- edges: Python ----------
from compas_singular.rhino.grasshopper import gh_mesh_edges
edge_vertices, edge_lines = gh_mesh_edges(mesh)
# ---------- end edges ----------
torhinomesh = ToRhinoMesh(mesh=cstrsmoothing_2)  # -> mesh_guid
# ---------- torhinomesh: Python ----------
from compas_singular.rhino.grasshopper import gh_to_rhino_mesh
mesh_guid = gh_to_rhino_mesh(mesh)
# ---------- end torhinomesh ----------
line = Line(edges.edge_lines)
