# Grasshopper definition 03_surface_quad_meshing.gh (Grasshopper 1.0.7)

tolerance_value = Slider(0.5, range=0..1)
# compas_singular
# Surface quad-meshing
# Robin Oval
# rpho2@cam.ac.uk
# https://github.com/BlockResearchGroup/compas_singular
srf = Surface(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)

crv = Curve()
pt = Point([Point(4.67783024, 0.3459388189, 1.951780041), Point(3.176917069, 5.551557034, 3.253131615)])

srfquaddec = SurfaceQuadDecomposition(surface_guid=srf, accuracy_value=tolerance_value, point_guids=pt)  # -> quad_mesh; inputs point_guids: list, curve_guids: list
# ---------- srfquaddec: Python ----------
from compas_singular.rhino.grasshopper import gh_surface_decomposition
quad_mesh = gh_surface_decomposition(surface_guid, accuracy_value, point_guids, curve_guids)
# ---------- end srfquaddec ----------
strips = QuadMeshStrips(quad_mesh=srfquaddec)  # -> strip_edges, strip_lines, strip_closed
# ---------- strips: Python ----------
from compas_singular.rhino.grasshopper import gh_quad_mesh_strips
strip_edges, strip_lines, strip_closed = gh_quad_mesh_strips(quad_mesh)
# ---------- end strips ----------
trim = TrimTree(Tree=strips.strip_lines, Depth=1)
len = Length(Curve=trim)
avr = Average(Input=len)
division = Division(A=avr, B=Slider(0.4, range=0..2))
max = Maximum(A=division, B=Slider(1, range=0..10))  # -> flatten(Result)
int = Integer(max)
densify = DensifyQuadMesh(quad_mesh=srfquaddec, strips_subdivision=int)  # -> dense_quad_mesh; inputs strips_subdivision: list of Int32
# ---------- densify: Python ----------
from compas_singular.rhino.grasshopper import gh_densifiying
dense_quad_mesh = gh_densifiying(quad_mesh, strips_subdivision)
# ---------- end densify ----------
quadmesh = QuadMesh(densify)
srf_2 = Surface(srf)

k = Slider(10, range=0..100)
d = Slider(0.5, range=0..1)

cluster = Cluster(srf=srf_2, quadmesh=quadmesh)  # -> geo_2, vkeys
cstrsmoothing = ConstrainedLaplacianSmoothing(mesh=densify, k=k, d=d, vertex_keys=cluster.vkeys, guid_constraints=cluster.geo_2)  # -> smooth_mesh; inputs k: Int32, vertex_keys: list, guid_constraints: list
# ---------- cstrsmoothing: Python ----------
from compas_singular.rhino.grasshopper import gh_constrained_smoothing
smooth_mesh = gh_constrained_smoothing(mesh, k, d, vertex_keys, guid_constraints)
# ---------- end cstrsmoothing ----------
torhinomesh = ToRhinoMesh(mesh=cstrsmoothing)  # -> mesh_guid
# ---------- torhinomesh: Python ----------
from compas_singular.rhino.grasshopper import gh_to_rhino_mesh
mesh_guid = gh_to_rhino_mesh(mesh)
# ---------- end torhinomesh ----------
mesh = Mesh(torhinomesh)

# ==== cluster Cluster
quadmesh = ClusterInput()
srf = ClusterInput()
quadmesh_2 = QuadMesh(quadmesh)
srf_2 = Surface(srf)
boundaryelements = BoundaryElements(mesh=quadmesh_2)  # -> vertex_on_boundary, face_on_boundary, edge_on_boundary
# ---------- boundaryelements: Python ----------
from compas_singular.rhino.grasshopper import gh_mesh_is_element_on_boundary
vertex_on_boundary, face_on_boundary, edge_on_boundary = gh_mesh_is_element_on_boundary(mesh)
# ---------- end boundaryelements ----------
vertices = MeshVertices(mesh=quadmesh_2)  # -> vertex_coordinates, vertex_normals, vertex_areas
# ---------- vertices: Python ----------
from compas_singular.rhino.grasshopper import gh_mesh_vertices
vertex_coordinates, vertex_normals, vertex_areas = gh_mesh_vertices(mesh)
# ---------- end vertices ----------
debrep = DeconstructBrep(Brep=srf_2)  # -> Faces, Edges, Vertices
crv = Curve(debrep.Edges)
cls = Closed(Curve=crv)  # -> Closed, Periodic
dispatch = Dispatch(List=vertices.vertex_coordinates, DispatchPattern=boundaryelements.vertex_on_boundary)  # -> ListA, ListB
dispatch_2 = Dispatch(List=crv, DispatchPattern=cls.Closed)  # -> ListA, ListB
lng = ListLength(List=boundaryelements.vertex_on_boundary)
panel = Panel("""0
1""")
crv_2 = Curve(debrep.Edges)
eval = EvaluateCurve(Curve=reparameterize(graft(dispatch_2.ListA)), Parameter=panel)  # -> Point, Tangent, Angle
lng_2 = ListLength(List=dispatch.ListA)
repeat = RepeatData(Data=debrep.Faces, Length=lng)
repeat_2 = RepeatData(Data=graft(crv_2), Length=lng_2)  # -> simplify(Data)
item = ListItem(List=eval.Tangent, Index=0, Wrap=True)  # -> Item, Item1
crv_cp = CurveClosestPoint(Point=graft(dispatch.ListA), Curve=crv_2)  # -> Point, Parameter, Distance
similar = Similarity(FirstNumber=item.Item, SecondNumber=item.Item1, Threshold=0.1)  # -> flatten(Similarity), AbsoluteDifference
flip = FlipMatrix(Data=repeat_2)
series = Series(Start=0, Step=1, Count=lng)
sort = SortList(Keys=simplify(crv_cp.Distance), ValuesA=flip)  # -> Keys, ValuesA
dispatch_3 = Dispatch(List=dispatch_2.ListA, DispatchPattern=similar.Similarity)  # -> ListA, ListB
dispatch_4 = Dispatch(List=series, DispatchPattern=boundaryelements.vertex_on_boundary)  # -> ListA, ListB
crv_3 = Curve([dispatch_2.ListB, dispatch_3.ListB])
item_2 = ListItem(List=sort.ValuesA, Index=0, Wrap=True)  # -> flatten(Item)
end = EndPoints(Curve=crv_3)  # -> Start, End
replace = ReplaceItems(List=repeat, Item=item_2, Indices=dispatch_4.ListA, Wrap=False)
pt = Point([end.Start, end.End])
pt_2 = Point(pt)
cp = ClosestPoint(Point=pt_2, Cloud=vertices.vertex_coordinates)  # -> ClosestPoint, CPIndex, Distance
replace_2 = ReplaceItems(List=replace, Item=pt_2, Indices=cp.CPIndex, Wrap=False)
geo = Geometry(replace_2)
lng_3 = ListLength(List=geo)
geo_2 = ClusterOutput(geo)
series_2 = Series(Start=0, Step=1, Count=lng_3)
vkeys = ClusterOutput(series_2)
