# Grasshopper definition 04_quad_mesh_topological_edit.gh (Grasshopper 1.0.7)

# compas_singular
# Quad-mesh topological edit
# Robin Oval
# rpho2@cam.ac.uk
# https://github.com/BlockResearchGroup/compas_singular
mesh = Mesh(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)
fromrhinomesh = FromRhinoMesh(mesh_guid=mesh)  # -> mesh; inputs poles: list
# ---------- fromrhinomesh: Python ----------
from compas_singular.rhino.grasshopper import gh_from_rhino_mesh
mesh = gh_from_rhino_mesh(mesh_guid, poles)
# ---------- end fromrhinomesh ----------
vertices = MeshVertices(mesh=fromrhinomesh)  # -> vertex_coordinates, vertex_normals, vertex_areas; same code as vertices
strips = QuadMeshStrips(quad_mesh=fromrhinomesh)  # -> strip_edges, strip_lines, strip_closed
# ---------- strips: Python ----------
from compas_singular.rhino.grasshopper import gh_quad_mesh_strips
strip_edges, strip_lines, strip_closed = gh_quad_mesh_strips(quad_mesh)
# ---------- end strips ----------
points = PointList(Points=vertices.vertex_coordinates, Size=0.35)
trim = TrimTree(Tree=strips.strip_lines, Depth=1)
curvepoint = PointOnCurve(trim, parameter=0.5)

panel = Panel("""2
4
7""")
panel_2 = Panel("""15
14
13
17""")

panel_3 = Panel("""3
8""")
pline = PolyLine(Vertices=curvepoint, Closed=strips.strip_closed)  # -> flatten(Polyline)
entwine = Entwine(Branch00=panel, Branch01=panel_2, FlattenInputs=True)  # -> simplify(Result)
curvepoint_2 = PointOnCurve(pline, parameter=0.5)
preview = CustomPreview(Geometry=pline, Material=ColourSwatch(SwatchColor=RGB(0, 0, 255)))
deletestrip = DeleteQuadMeshStrips(mesh=fromrhinomesh, strips_to_delete=panel_3)  # -> edited_mesh; inputs strips_to_delete: list of Int32
# ---------- deletestrip: Python ----------
from compas_singular.rhino.grasshopper import gh_delete_strips
edited_mesh = gh_delete_strips(mesh, strips_to_delete)
# ---------- end deletestrip ----------
editstrip = EditQuadMeshStripTopology(mesh=fromrhinomesh, strips_to_add=entwine, strips_to_delete=panel_3)  # -> edited_mesh; inputs strips_to_add: tree of Int32, strips_to_delete: list of Int32
# ---------- editstrip: Python ----------
from compas_singular.rhino.grasshopper import gh_add_delete_strips
edited_mesh = gh_add_delete_strips(mesh, strips_to_add, strips_to_delete)
# ---------- end editstrip ----------
addstrip = AddQuadMeshStrips(mesh=fromrhinomesh, strips_to_add=entwine)  # -> edited_mesh; inputs strips_to_add: tree of Int32
# ---------- addstrip: Python ----------
from compas_singular.rhino.grasshopper import gh_add_strips
edited_mesh = gh_add_strips(mesh, strips_to_add)
# ---------- end addstrip ----------
points_2 = PointList(Points=curvepoint_2, Size=0.5)
quadmesh = QuadMesh(editstrip)

k = Slider(1, range=0..100)
d = Slider(0.5, range=0..1)

srf = Surface(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)
cluster = Cluster(srf=srf, data=quadmesh)  # -> geo_2, vkeys
cstrsmoothing = ConstrainedLaplacianSmoothing(mesh=quadmesh, k=k, d=d, vertex_keys=cluster.vkeys, guid_constraints=cluster.geo_2)  # -> smooth_mesh; inputs k: Int32, vertex_keys: list, guid_constraints: list
# ---------- cstrsmoothing: Python ----------
from compas_singular.rhino.grasshopper import gh_constrained_smoothing
smooth_mesh = gh_constrained_smoothing(mesh, k, d, vertex_keys, guid_constraints)
# ---------- end cstrsmoothing ----------
vertices_2 = MeshVertices(mesh=cstrsmoothing)  # -> vertex_coordinates, vertex_normals, vertex_areas; same code as vertices
X = UnitX(Factor="11")
lng = ListLength(List=vertices_2.vertex_coordinates)
series = Series(Start=0, Step=1, Count=lng)
repeat = RepeatData(Data=X, Length=lng)
movevertices = MoveVertices(mesh=cstrsmoothing, vertex_indices=series, vectors=repeat)  # -> moved_mesh; inputs vertex_indices: list, vectors: list
# ---------- movevertices: Python ----------
from compas_singular.rhino.grasshopper import gh_move_vertices
moved_mesh = gh_move_vertices(mesh, vertex_indices, vectors)
# ---------- end movevertices ----------
singularities = QuadMeshSingularities(quad_mesh=movevertices)  # -> singularity_indices, singularity_coordinates
# ---------- singularities: Python ----------
from compas_singular.rhino.grasshopper import gh_quad_mesh_singularities
singularity_indices, singularity_coordinates = gh_quad_mesh_singularities(quad_mesh)
# ---------- end singularities ----------
torhinomesh = ToRhinoMesh(mesh=movevertices)  # -> mesh_guid
# ---------- torhinomesh: Python ----------
from compas_singular.rhino.grasshopper import gh_to_rhino_mesh
mesh_guid = gh_to_rhino_mesh(mesh)
# ---------- end torhinomesh ----------
circle = CircleCNR(Center=singularities.singularity_coordinates, Normal=Vector(0, 0, 1), Radius=Slider(0.2, range=0..1))
mesh_2 = Mesh(torhinomesh)
boundary = BoundarySurfaces(Edges=circle)
preview_2 = CustomPreview(Geometry=boundary, Material=ColourSwatch(SwatchColor=RGB(255, 0, 255)))

# ==== cluster Cluster
data = ClusterInput()
srf = ClusterInput()
data_2 = Data(data)
srf_2 = Surface(srf)
boundaryelements = BoundaryElements(mesh=data_2)  # -> vertex_on_boundary, face_on_boundary, edge_on_boundary
# ---------- boundaryelements: Python ----------
from compas_singular.rhino.grasshopper import gh_mesh_is_element_on_boundary
vertex_on_boundary, face_on_boundary, edge_on_boundary = gh_mesh_is_element_on_boundary(mesh)
# ---------- end boundaryelements ----------
vertices = MeshVertices(mesh=data_2)  # -> vertex_coordinates, vertex_normals, vertex_areas
# ---------- vertices: Python ----------
from compas_singular.rhino.grasshopper import gh_mesh_vertices
vertex_coordinates, vertex_normals, vertex_areas = gh_mesh_vertices(mesh)
# ---------- end vertices ----------
debrep = DeconstructBrep(Brep=srf_2)  # -> Faces, Edges, Vertices
crv = Curve(debrep.Edges)
cls = Closed(Curve=crv)  # -> Closed, Periodic
dispatch = Dispatch(List=vertices.vertex_coordinates, DispatchPattern=boundaryelements.vertex_on_boundary)  # -> ListA, ListB
dispatch_2 = Dispatch(List=crv, DispatchPattern=cls.Closed)  # -> ListA, ListB
lng = ListLength(List=boundaryelements.vertex_on_boundary)
panel = Panel("""0
1""")
crv_2 = Curve(debrep.Edges)
eval = EvaluateCurve(Curve=reparameterize(graft(dispatch_2.ListA)), Parameter=panel)  # -> Point, Tangent, Angle
lng_2 = ListLength(List=dispatch.ListA)
repeat = RepeatData(Data=debrep.Faces, Length=lng)
repeat_2 = RepeatData(Data=graft(crv_2), Length=lng_2)  # -> simplify(Data)
item = ListItem(List=eval.Tangent, Index=0, Wrap=True)  # -> Item, Item1
crv_cp = CurveClosestPoint(Point=graft(dispatch.ListA), Curve=crv_2)  # -> Point, Parameter, Distance
similar = Similarity(FirstNumber=item.Item, SecondNumber=item.Item1, Threshold=0.1)  # -> flatten(Similarity), AbsoluteDifference
flip = FlipMatrix(Data=repeat_2)
series = Series(Start=0, Step=1, Count=lng)
sort = SortList(Keys=simplify(crv_cp.Distance), ValuesA=flip)  # -> Keys, ValuesA
dispatch_3 = Dispatch(List=dispatch_2.ListA, DispatchPattern=similar.Similarity)  # -> ListA, ListB
dispatch_4 = Dispatch(List=series, DispatchPattern=boundaryelements.vertex_on_boundary)  # -> ListA, ListB
crv_3 = Curve([dispatch_2.ListB, dispatch_3.ListB])
item_2 = ListItem(List=sort.ValuesA, Index=0, Wrap=True)  # -> flatten(Item)
end = EndPoints(Curve=crv_3)  # -> Start, End
replace = ReplaceItems(List=repeat, Item=item_2, Indices=dispatch_4.ListA, Wrap=False)
pt = Point([end.Start, end.End])
pt_2 = Point(pt)
cp = ClosestPoint(Point=pt_2, Cloud=vertices.vertex_coordinates)  # -> ClosestPoint, CPIndex, Distance
replace_2 = ReplaceItems(List=replace, Item=pt_2, Indices=cp.CPIndex, Wrap=False)
geo = Geometry(replace_2)
lng_3 = ListLength(List=geo)
geo_2 = ClusterOutput(geo)
series_2 = Series(Start=0, Step=1, Count=lng_3)
vkeys = ClusterOutput(series_2)
