# Grasshopper definition 01_quad_mesh_data.gh (Grasshopper 1.0.7)

# singular | compas_pattern
# Quad mesh data
# Robin Oval
# rpho2@cam.ac.uk
# https://github.com/BlockResearchGroup/compas_pattern
mesh = Mesh(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)
fromrhinomesh = FromRhinoMesh(mesh_guid=mesh)  # -> mesh
# ---------- fromrhinomesh: Python ----------
from compas_pattern.rhino.grasshopper import gh_from_rhino_mesh
mesh = gh_from_rhino_mesh(mesh_guid)
# ---------- end fromrhinomesh ----------
torhinomesh = ToRhinoMesh(mesh=fromrhinomesh)  # -> mesh_guid
# ---------- torhinomesh: Python ----------
from compas_pattern.rhino.grasshopper import gh_to_rhino_mesh
mesh_guid = gh_to_rhino_mesh(mesh)
# ---------- end torhinomesh ----------
vertices = MeshVertices(mesh=fromrhinomesh)  # -> vertex_coordinates
# ---------- vertices: Python ----------
from compas_pattern.rhino.grasshopper import gh_vertices
vertex_coordinates = gh_vertices(mesh)
# ---------- end vertices ----------
faces = MeshFaces(mesh=fromrhinomesh)  # -> face_vertices
# ---------- faces: Python ----------
from compas_pattern.rhino.grasshopper import gh_faces
face_vertices = gh_faces(mesh)
# ---------- end faces ----------
edges = MeshEdges(mesh=fromrhinomesh)  # -> edge_vertices
# ---------- edges: Python ----------
from compas_pattern.rhino.grasshopper import gh_edges
edge_vertices = gh_edges(mesh)
# ---------- end edges ----------
singularities = QuadMeshSingularities(quad_mesh=fromrhinomesh)  # -> singularities
# ---------- singularities: Python ----------
from compas_pattern.rhino.grasshopper import gh_singularities
singularities = gh_singularities(quad_mesh)
# ---------- end singularities ----------
storepolyedges = StorePolyedges(quad_mesh=fromrhinomesh)  # -> quad_mesh
# ---------- storepolyedges: Python ----------
from compas_pattern.rhino.grasshopper import gh_store_polyedges
quad_mesh = gh_store_polyedges(quad_mesh)
# ---------- end storepolyedges ----------
storestrips = StoreStrips(quad_mesh=fromrhinomesh)  # -> quad_mesh
# ---------- storestrips: Python ----------
from compas_pattern.rhino.grasshopper import gh_store_strips
quad_mesh = gh_store_strips(quad_mesh)
# ---------- end storestrips ----------
mesh_2 = Mesh(torhinomesh)
polyedges = QuadMeshPolyedges(quad_mesh=storepolyedges)  # -> polyedge_vertices, polyedge_closed
# ---------- polyedges: Python ----------
from compas_pattern.rhino.grasshopper import gh_polyedges
polyedge_vertices, polyedge_closed = gh_polyedges(quad_mesh)
# ---------- end polyedges ----------
strips = QuadMeshStrips(quad_mesh=storestrips)  # -> strip_edges, strip_closed
# ---------- strips: Python ----------
from compas_pattern.rhino.grasshopper import gh_strips
strip_edges, strip_closed = gh_strips(quad_mesh)
# ---------- end strips ----------
item = ListItem(List=vertices, Index=singularities, Wrap=True)
item_2 = ListItem(List=vertices, Index=faces, Wrap=True)
item_3 = ListItem(List=vertices, Index=edges, Wrap=True)
item_4 = ListItem(List=item_3, Index=0, Wrap=True)  # -> Item, Item1
pt = Point(item)
points = PointList(Points=vertices, Size=0.2)
pline = PolyLine(Vertices=item_2, Closed=True)
item_5 = ListItem(List=vertices, Index=strips.strip_edges, Wrap=True)
ln = Line(StartPoint=item_4.Item, EndPoint=item_4.Item1)
item_6 = ListItem(List=vertices, Index=polyedges.polyedge_vertices, Wrap=True)
crv = Curve(flatten(pline))
intersection = SetIntersection(SetA=polyedges.polyedge_vertices, SetB=singularities)  # -> simplify(Union)
item_7 = ListItem(List=item_5, Index=0, Wrap=True)  # -> Item, Item1
line = Line(flatten(ln))
pline_2 = PolyLine(Vertices=item_6, Closed=polyedges.polyedge_closed)
lng = ListLength(List=intersection)
ln_2 = Line(StartPoint=item_7.Item, EndPoint=item_7.Item1)
dispatch = Dispatch(List=flatten(pline_2), DispatchPattern=flatten(lng))  # -> ListA, ListB
trim = TrimTree(Tree=ln_2, Depth=1)
crv_2 = Curve(dispatch.ListA)
curvepoint = PointOnCurve(trim, parameter=0.5)
python = GhPythonScript(mesh=fromrhinomesh)  # -> vertex_on_boundary, face_on_boundary, edge_on_boundary
# ---------- python: Python ----------
from compas_pattern.rhino.grasshopper import gh_boundary_elements
vertex_on_boundary, face_on_boundary, edge_on_boundary = gh_boundary_elements(mesh)
# ---------- end python ----------
pline_3 = PolyLine(Vertices=curvepoint, Closed=strips.strip_closed)
crv_3 = Curve(pline_3)
dispatch_2 = Dispatch(List=vertices, DispatchPattern=python.vertex_on_boundary)  # -> ListA, ListB
dispatch_3 = Dispatch(List=crv, DispatchPattern=python.face_on_boundary)  # -> ListA, ListB
dispatch_4 = Dispatch(List=line, DispatchPattern=python.edge_on_boundary)  # -> ListA, ListB
pt_2 = Point(dispatch_2.ListA)
crv_4 = Curve(dispatch_3.ListA)
crv_5 = Curve(dispatch_4.ListA)
