# Grasshopper definition 02_quad_mesh_densification_and_patterning.gh (Grasshopper 1.0.7)

# singular | compas_pattern
# Quad mesh densification and patterning
# Robin Oval
# rpho2@cam.ac.uk
# https://github.com/BlockResearchGroup/compas_pattern
mesh = Mesh(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)
fromrhinomesh = FromRhinoMesh(mesh_guid=mesh)  # -> mesh
# ---------- fromrhinomesh: Python ----------
from singular.rhino.grasshopper import gh_from_rhino_mesh
mesh = gh_from_rhino_mesh(mesh_guid)
# ---------- end fromrhinomesh ----------
coarsen = CoarsenQuadMesh(quad_mesh=fromrhinomesh)  # -> coarse_quad_mesh
# ---------- coarsen: Python ----------
from singular.rhino.grasshopper import gh_coarsening
coarse_quad_mesh = gh_coarsening(quad_mesh)
# ---------- end coarsen ----------
vertices = MeshVertices(mesh=coarsen)  # -> vertex_coordinates
# ---------- vertices: Python ----------
from singular.rhino.grasshopper import gh_vertices
vertex_coordinates = gh_vertices(mesh)
# ---------- end vertices ----------
strips = QuadMeshStrips(quad_mesh=coarsen)  # -> strip_edges, strip_closed
# ---------- strips: Python ----------
from singular.rhino.grasshopper import gh_strips
strip_edges, strip_closed = gh_strips(quad_mesh)
# ---------- end strips ----------
item = ListItem(List=vertices, Index=strips.strip_edges, Wrap=True)
item_2 = ListItem(List=item, Index=0, Wrap=True)  # -> Item, Item1
ln = Line(StartPoint=item_2.Item, EndPoint=item_2.Item1)
trim = TrimTree(Tree=ln, Depth=1)

target_length = Slider(1.2, range=0..2)
min_subdivision = Slider(1, range=0..10)

len = Length(Curve=trim)
avr = Average(Input=len)
division = Division(A=avr, B=target_length)
max = Maximum(A=division, B=min_subdivision)  # -> flatten(Result)
srf = Surface(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)
densify = DensifyQuadMesh(quad_mesh=coarsen, strips_subdivision=max)  # -> dense_quad_mesh; inputs strips_subdivision: list of Int32
# ---------- densify: Python ----------
from singular.rhino.grasshopper import gh_densifiying
dense_quad_mesh = gh_densifiying(quad_mesh, strips_subdivision)
# ---------- end densify ----------
quadmesh = QuadMesh(densify)
vertices_2 = MeshVertices(mesh=quadmesh)  # -> vertex_coordinates; same code as vertices
boundaryelements = BoundaryElements(mesh=quadmesh)  # -> vertex_on_boundary, face_on_boundary, edge_on_boundary
# ---------- boundaryelements: Python ----------
from singular.rhino.grasshopper import gh_boundary_elements
vertex_on_boundary, face_on_boundary, edge_on_boundary = gh_boundary_elements(mesh)
# ---------- end boundaryelements ----------
debrep = DeconstructBrep(Brep=srf)  # -> Faces, Edges, Vertices

k = Slider(10, range=0..100)
d = Slider(0.5, range=0..1)

lng = ListLength(List=vertices_2)
series = Series(Start=0, Step=1, Count=lng)
dispatch = Dispatch(List=series, DispatchPattern=boundaryelements.vertex_on_boundary)  # -> ListA, ListB
lng_2 = ListLength(List=dispatch.ListA)
repeat = RepeatData(Data=debrep.Edges, Length=lng_2)
cstrsmoothing = ConstrainedLaplacianSmoothing(mesh=densify, k=k, d=d, vertex_keys=dispatch.ListA, guid_constraints=repeat)  # -> smooth_mesh; inputs k: Int32, vertex_keys: list, guid_constraints: list
# ---------- cstrsmoothing: Python ----------
from singular.rhino.grasshopper import gh_constrained_smoothing
smooth_mesh = gh_constrained_smoothing(mesh, k, d, vertex_keys, guid_constraints)
# ---------- end cstrsmoothing ----------
list = ValueList({"seed", "dual", "join", "ambo", "kis", "needle", "zip", "truncate", "ortho", "expand", "gyro", "snub", "meta", "bevel"}, selected="gyro")
conway = ConwayOperator(mesh=cstrsmoothing, operator=list)  # -> polygonal_mesh
# ---------- conway: Python ----------
from singular.rhino.grasshopper import gh_conway
polygonal_mesh = gh_conway(mesh, operator)
# ---------- end conway ----------
quadmesh_2 = QuadMesh(conway)

k_2 = Slider(5, range=0..100)
d_2 = Slider(0.5, range=0..1)

vertices_3 = MeshVertices(mesh=quadmesh_2)  # -> vertex_coordinates; same code as vertices
boundaryelements_2 = BoundaryElements(mesh=quadmesh_2)  # -> vertex_on_boundary, face_on_boundary, edge_on_boundary; same code as boundaryelements
lng_3 = ListLength(List=vertices_3)
series_2 = Series(Start=0, Step=1, Count=lng_3)
dispatch_2 = Dispatch(List=series_2, DispatchPattern=boundaryelements_2.vertex_on_boundary)  # -> ListA, ListB
lng_4 = ListLength(List=dispatch_2.ListA)
repeat_2 = RepeatData(Data=debrep.Edges, Length=lng_4)
cstrsmoothing_2 = ConstrainedLaplacianSmoothing(mesh=conway, k=k_2, d=d_2, vertex_keys=dispatch_2.ListA, guid_constraints=repeat_2)  # -> smooth_mesh; inputs k: Int32, vertex_keys: list, guid_constraints: list; same code as cstrsmoothing
torhinomesh = ToRhinoMesh(mesh=cstrsmoothing_2)  # -> mesh_guid
# ---------- torhinomesh: Python ----------
from singular.rhino.grasshopper import gh_to_rhino_mesh
mesh_guid = gh_to_rhino_mesh(mesh)
# ---------- end torhinomesh ----------
vertices_4 = MeshVertices(mesh=cstrsmoothing_2)  # -> vertex_coordinates; same code as vertices
edges = MeshEdges(mesh=cstrsmoothing_2)  # -> edge_vertices
# ---------- edges: Python ----------
from singular.rhino.grasshopper import gh_edges
edge_vertices = gh_edges(mesh)
# ---------- end edges ----------
item_3 = ListItem(List=vertices_4, Index=edges, Wrap=True)
item_4 = ListItem(List=item_3, Index=0, Wrap=True)  # -> Item, Item1
ln_2 = Line(StartPoint=item_4.Item, EndPoint=item_4.Item1)
line = Line(ln_2)
