# Grasshopper definition 03_surface_quad_meshing.gh (Grasshopper 1.0.7)

tolerance_value = Slider(0.5, range=0..1)
# singular | compas_pattern
# Surface quad-meshing
# Robin Oval
# rpho2@cam.ac.uk
# https://github.com/BlockResearchGroup/compas_pattern
srf = Surface(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)

crv = Curve()
pt = Point([Point(4.67783024, 0.3459388189, 1.951780041), Point(3.176917069, 5.551557034, 3.253131615)])

srfquaddec = SurfaceQuadDecomposition(surface_guid=srf, accuracy_value=tolerance_value, point_guids=pt)  # -> quad_mesh; inputs point_guids: list, curve_guids: list
# ---------- srfquaddec: Python ----------
from compas_pattern.rhino.grasshopper import gh_surface_decomposition
quad_mesh = gh_surface_decomposition(surface_guid, accuracy_value, point_guids, curve_guids)
# ---------- end srfquaddec ----------
storestrips = StoreStrips(quad_mesh=srfquaddec)  # -> quad_mesh
# ---------- storestrips: Python ----------
from compas_pattern.rhino.grasshopper import gh_store_strips
quad_mesh = gh_store_strips(quad_mesh)
# ---------- end storestrips ----------
vertices = MeshVertices(mesh=storestrips)  # -> vertex_coordinates; same code as vertices
strips = QuadMeshStrips(quad_mesh=storestrips)  # -> strip_edges, strip_closed
# ---------- strips: Python ----------
from compas_pattern.rhino.grasshopper import gh_strips
strip_edges, strip_closed = gh_strips(quad_mesh)
# ---------- end strips ----------
item = ListItem(List=vertices, Index=strips.strip_edges, Wrap=True)
item_2 = ListItem(List=item, Index=0, Wrap=True)  # -> Item, Item1
ln = Line(StartPoint=item_2.Item, EndPoint=item_2.Item1)
trim = TrimTree(Tree=ln, Depth=1)
len = Length(Curve=trim)
avr = Average(Input=len)
division = Division(A=avr, B=Slider(0.4, range=0..2))
max = Maximum(A=division, B=Slider(1, range=0..10))  # -> flatten(Result)
int = Integer(max)
densify = DensifyQuadMesh(quad_mesh=storestrips, strips_subdivision=int)  # -> dense_quad_mesh; inputs strips_subdivision: list of Int32
# ---------- densify: Python ----------
from compas_pattern.rhino.grasshopper import gh_densifiying
dense_quad_mesh = gh_densifiying(quad_mesh, strips_subdivision)
# ---------- end densify ----------
srf_2 = Surface(srf)
data = Data(densify)

k = Slider(10, range=0..100)
d = Slider(0.5, range=0..1)

cluster = Cluster(srf=srf_2, data=data)
geo = Geometry(cluster)
cstrsmoothing = ConstrainedLaplacianSmoothing(mesh=densify, k=k, d=d, guid_constraints=geo)  # -> smooth_mesh; inputs k: Int32, guid_constraints: list
# ---------- cstrsmoothing: Python ----------
from compas_pattern.rhino.grasshopper import gh_constrained_smoothing
smooth_mesh = gh_constrained_smoothing(mesh, k, d, guid_constraints)
# ---------- end cstrsmoothing ----------
torhinomesh = ToRhinoMesh(mesh=cstrsmoothing)  # -> mesh_guid
# ---------- torhinomesh: Python ----------
from compas_pattern.rhino.grasshopper import gh_to_rhino_mesh
mesh_guid = gh_to_rhino_mesh(mesh)
# ---------- end torhinomesh ----------
mesh = Mesh(torhinomesh)

# ==== cluster Cluster
data = ClusterInput()
srf = ClusterInput()
data_2 = Data(data)
srf_2 = Surface(srf)
python = GhPythonScript(mesh=data_2)  # -> vertex_on_boundary, face_on_boundary, edge_on_boundary
# ---------- python: Python ----------
from compas_pattern.rhino.grasshopper import gh_boundary_elements
vertex_on_boundary, face_on_boundary, edge_on_boundary = gh_boundary_elements(mesh)
# ---------- end python ----------
vertices = MeshVertices(mesh=data_2)  # -> vertex_coordinates
# ---------- vertices: Python ----------
from compas_pattern.rhino.grasshopper import gh_vertices
vertex_coordinates = gh_vertices(mesh)
# ---------- end vertices ----------
debrep = DeconstructBrep(Brep=srf_2)  # -> Faces, Edges, Vertices
crv = Curve(debrep.Edges)
cls = Closed(Curve=crv)  # -> Closed, Periodic
dispatch = Dispatch(List=vertices, DispatchPattern=python.vertex_on_boundary)  # -> ListA, ListB
dispatch_2 = Dispatch(List=crv, DispatchPattern=cls.Closed)  # -> ListA, ListB
lng = ListLength(List=python.vertex_on_boundary)
panel = Panel("""0
1""")
crv_2 = Curve(debrep.Edges)
eval = EvaluateCurve(Curve=reparameterize(graft(dispatch_2.ListA)), Parameter=panel)  # -> Point, Tangent, Angle
lng_2 = ListLength(List=dispatch.ListA)
repeat = RepeatData(Data=debrep.Faces, Length=lng)
repeat_2 = RepeatData(Data=graft(crv_2), Length=lng_2)  # -> simplify(Data)
item = ListItem(List=eval.Tangent, Index=0, Wrap=True)  # -> Item, Item1
crv_cp = CurveClosestPoint(Point=graft(dispatch.ListA), Curve=crv_2)  # -> Point, Parameter, Distance
similar = Similarity(FirstNumber=item.Item, SecondNumber=item.Item1, Threshold=0.1)  # -> flatten(Similarity), AbsoluteDifference
flip = FlipMatrix(Data=repeat_2)
series = Series(Start=0, Step=1, Count=lng)
sort = SortList(Keys=simplify(crv_cp.Distance), ValuesA=flip)  # -> Keys, ValuesA
dispatch_3 = Dispatch(List=dispatch_2.ListA, DispatchPattern=similar.Similarity)  # -> ListA, ListB
dispatch_4 = Dispatch(List=series, DispatchPattern=python.vertex_on_boundary)  # -> ListA, ListB
crv_3 = Curve([dispatch_2.ListB, dispatch_3.ListB])
item_2 = ListItem(List=sort.ValuesA, Index=0, Wrap=True)  # -> flatten(Item)
end = EndPoints(Curve=crv_3)  # -> Start, End
replace = ReplaceItems(List=repeat, Item=item_2, Indices=dispatch_4.ListA, Wrap=False)
pt = Point([end.Start, end.End])
pt_2 = Point(pt)
cp = ClosestPoint(Point=pt_2, Cloud=vertices)  # -> ClosestPoint, CPIndex, Distance
replace_2 = ReplaceItems(List=replace, Item=pt_2, Indices=cp.CPIndex, Wrap=False)
geo = Geometry(replace_2)
geo_2 = ClusterOutput(geo)
