# Grasshopper definition singular_GH_adjacent_topologies.gh (Grasshopper 0.9.76)
# plug-ins: Python Interpreter

# singular GH
# adjacent topologies
# by Robin OVAL
# from compas_pattern
# https://github.com/BlockResearchGroup/compas_pattern
srf = Surface(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)

# ----
# DECOMPOSITION
number_slider = Slider(2, range=0..5)
python = PythonScript(surface=srf, precision=number_slider)  # -> out, coarse_quad_mesh
# ---------- python: Python ----------
from compas_pattern.algorithms.decomposition.algorithm import surface_decomposition

coarse_quad_mesh = surface_decomposition(surface, precision, output_skeleton = False)[0]
coarse_quad_mesh.init_strip_density()
# ---------- end python ----------

# ----
# JUST CHOOSE
number_slider_2 = Slider(0, range=0..100)

# ----
# ADJACENT TOPOLOGIES
# DELETING STRIPS
# ADDING STRIPS
# max strip length (= number of faces)
kmax = Slider(4, range=0..10)
python_2 = PythonScript(mesh=python.coarse_quad_mesh)  # -> out, adj_topo_del
# ---------- python_2: Python ----------
from compas_pattern.algorithms.adjacent_topologies import adjacent_topologies_delete

adj_topo_del = [results[0] for results in adjacent_topologies_delete(mesh, 1)]
# ---------- end python_2 ----------
python_3 = PythonScript(mesh=python.coarse_quad_mesh, kmax=kmax)  # -> out, adj_topo_add; inputs kmax: Int32
# ---------- python_3: Python ----------
from compas_pattern.algorithms.adjacent_topologies import adjacent_topologies_add

adj_topo_add = [results[0] for values in adjacent_topologies_add(mesh, kmax).values() for results in values]
# ---------- end python_3 ----------
merge = Merge(Data1=python_2.adj_topo_del, Data2=python_3.adj_topo_add)
item = ListItem(List=merge, Index=number_slider_2, Wrap=True)

# ----
# compas_pattern data structure
# to Rhino mesh
python_4 = PythonScript(smooth_mesh=item)  # -> out, guids
# ---------- python_4: Python ----------
from compas_pattern.cad.rhino.utilities import draw_mesh

guids = draw_mesh(smooth_mesh, group = False)
# ---------- end python_4 ----------

geo = Geometry(python_4.guids)
