# Grasshopper definition singular_GH_pattern_on_surface.gh (Grasshopper 0.9.76)
# plug-ins: Python Interpreter

# singular GH
# pattern on a surface
# by Robin OVAL
# from compas_pattern
# https://github.com/BlockResearchGroup/compas_pattern
srf = Surface(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)

# ----
# DECOMPOSITION
number_slider = Slider(2, range=0..5)
python = PythonScript(surface=srf, precision=number_slider)  # -> out, coarse_quad_mesh
# ---------- python: Python ----------
from compas_pattern.algorithms.decomposition.algorithm import surface_decomposition

coarse_quad_mesh = surface_decomposition(surface, precision, output_skeleton = False)[0]
coarse_quad_mesh.init_strip_density()
# ---------- end python ----------

# ----
# DENSITY
number_slider_2 = Slider(2.1, range=0..5)
python_2 = PythonScript(coarse_quad_mesh=python.coarse_quad_mesh, density_target=number_slider_2)  # -> out, quad_mesh
# ---------- python_2: Python ----------
coarse_quad_mesh.set_strips_density_target(density_target)
coarse_quad_mesh.densification()
quad_mesh = coarse_quad_mesh.quad_mesh
# ---------- end python_2 ----------

# ----
# CONWAY OPERATORS
list = ValueList({"seed", "dual", "join", "ambo", "kis", "needle", "zip", "truncate", "ortho", "expand", "gyro", "snub", "meta", "bevel"}, selected="seed")
python_3 = PythonScript(quad_mesh=python_2.quad_mesh, operator=list)  # -> out, polygonal_mesh
# ---------- python_3: Python ----------
from compas.topology.conway import *

if operator == 'seed':
    polygonal_mesh = quad_mesh.copy()
else:
    conway_operators = {'dual': conway_dual, 'join': conway_join, 'ambo': conway_ambo, 'kis': conway_kis, 'needle': conway_needle, 'zip': conway_zip, 'truncate': conway_truncate, 'ortho': conway_ortho, 'expand': conway_expand, 'gyro': conway_gyro, 'snub': conway_snub, 'meta': conway_meta, 'bevel': conway_bevel}
    polygonal_mesh = conway_operators[operator](quad_mesh.copy())
# ---------- end python_3 ----------

kmax = Slider(20, range=0..100)
damping = Slider(0.5, range=0..1)

# ----
# GEOMETRY - SMOOTHING
# smooth quad mesh
# with constraints
# apply constraints
python_4 = PythonScript(polygonal_mesh=python_3.polygonal_mesh, surface=srf)  # -> out, constrained_mesh, vertex_constraints, object_constraints
# ---------- python_4: Python ----------
import rhinoscriptsyntax as rs
from compas_pattern.cad.rhino.objects.surface import RhinoSurface
from compas_pattern.algorithms.relaxation.constraints import automated_smoothing_constraints

constrained_mesh = polygonal_mesh.copy()

points = [rs.AddPoint(point) for point in RhinoSurface(surface).kinks()]
curves = RhinoSurface(surface).borders(type = 0)

constraints = automated_smoothing_constraints(constrained_mesh, points, curves, surface)

object_constraints = [surface] + curves + points

for key, object in constraints.items():
    constraints[key] = object_constraints.index(object)

vertex_constraints = list(constraints.items())
# ---------- end python_4 ----------
python_5 = PythonScript(
    constrained_mesh=python_4.constrained_mesh,
    kmax=kmax,
    damping=damping,
    vertex_constraints=python_4.vertex_constraints,
    object_constraints=python_4.object_constraints)  # -> out, smooth_mesh; inputs kmax: Int32, vertex_constraints: list, object_constraints: list
# ---------- python_5: Python ----------
from compas_pattern.algorithms.relaxation.relaxation import constrained_smoothing

smooth_mesh = constrained_mesh.copy()

vertex_constraints = {key_object[0]: object_constraints[key_object[1]] for key_object in vertex_constraints}

constrained_smoothing(smooth_mesh, kmax, damping, vertex_constraints, algorithm = 'area')
# ---------- end python_5 ----------

# ----
# compas_pattern data structure
# to Rhino mesh
python_6 = PythonScript(smooth_mesh=python_5.smooth_mesh)  # -> out, guids
# ---------- python_6: Python ----------
from compas_pattern.cad.rhino.draw import draw_mesh

guids = draw_mesh(smooth_mesh, group = False)
# ---------- end python_6 ----------

geo = Geometry(python_6.guids)
