# Grasshopper definition singular_GH_quad_mesh_redensification.gh (Grasshopper 0.9.76)
# plug-ins: Python Interpreter, Weaverbird, Kangaroo2 Components

# singular GH
# quad mesh redensification
# by Robin OVAL
# from compas_pattern
# https://github.com/BlockResearchGroup/compas_pattern
# QUAD MESH
mesh = Mesh(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)

# ----
# EXTRACTION
# from quad mesh
# to coarse quad mesh
python_script = PythonScript(mesh_guid=mesh)  # -> out, coarse_quad_mesh
# ---------- python_script: Python ----------
from compas_rhino.geometry import RhinoMesh
from compas_pattern.datastructures.mesh_quad.mesh_quad import QuadMesh
from compas_pattern.datastructures.mesh_quad_coarse.mesh_quad_coarse import CoarseQuadMesh

coarse_quad_mesh = CoarseQuadMesh.from_quad_mesh(QuadMesh.from_vertices_and_faces(*RhinoMesh.from_guid(mesh_guid).get_vertices_and_faces()))
# ---------- end python_script ----------

# ----
# DENSITY
# strip data
# local density values
# redefine density parameters
python = PythonScript(coarse_quad_mesh=python_script.coarse_quad_mesh)  # -> out, strip_polylines
# ---------- python: Python ----------
import rhinoscriptsyntax as rs

strip_polylines = [rs.AddPolyline(coarse_quad_mesh.strip_edge_polyline(skey)) for skey in coarse_quad_mesh.strips()]
# ---------- end python ----------
lng = ListLength(List=python.strip_polylines)
number_of_strips = Panel(lng)
genes = GenePool(Decimals=0, Maximum=15, Minimum=1, Value=[10.33333333, 5.666666667, 15, 2, 7.222222222])
python_2 = PythonScript(coarse_quad_mesh=python_script.coarse_quad_mesh, density_values=genes)  # -> out, quad_mesh; inputs density_values: list of Int32
# ---------- python_2: Python ----------
for i, skey in enumerate(coarse_quad_mesh.strips()):
    coarse_quad_mesh.set_strip_density(skey, density_values[i])
coarse_quad_mesh.densification()
quad_mesh = coarse_quad_mesh.quad_mesh
# ---------- end python_2 ----------

# ----
# CONWAY OPERATORS
list = ValueList({"seed", "dual", "join", "ambo", "kis", "needle", "zip", "truncate", "ortho", "expand", "gyro", "snub", "meta", "bevel"}, selected="seed")
python_3 = PythonScript(quad_mesh=python_2.quad_mesh, operator=list)  # -> out, polygonal_mesh
# ---------- python_3: Python ----------
import copy

from compas.topology.conway import *

quad_mesh = copy.deepcopy(quad_mesh)

if operator == 'seed':
    polygonal_mesh = quad_mesh.copy()
else:
    conway_operators = {'dual': conway_dual, 'join': conway_join, 'ambo': conway_ambo, 'kis': conway_kis, 'needle': conway_needle, 'zip': conway_zip, 'truncate': conway_truncate, 'ortho': conway_ortho, 'expand': conway_expand, 'gyro': conway_gyro, 'snub': conway_snub, 'meta': conway_meta, 'bevel': conway_bevel}
    polygonal_mesh = conway_operators[operator](quad_mesh.copy())
# ---------- end python_3 ----------

kmax = Slider(50, range=0..100)
damping = Slider(0.5, range=0..1)

# ----
# GEOMETRY - SMOOTHING
# smooth quad mesh
# with constraints
# apply constraints
number_slider = Slider(15, range=1..90)
wbnaked = WeaverbirdsNakedBoundary(MeshClosedPolylines=mesh)
rad = Radians(Degrees=number_slider)
splitatcorners = SplitAtCorners(Poly=wbnaked, Angle=rad)  # -> Corners, Parts
python_4 = PythonScript(polygonal_mesh=python_3.polygonal_mesh, points=splitatcorners.Corners, curves=splitatcorners.Parts)  # -> out, constrained_mesh, vertex_constraints, object_constraints; inputs points: list, curves: list
# ---------- python_4: Python ----------
import copy

import rhinoscriptsyntax as rs
from compas_pattern.cad.rhino.objects.surface import RhinoSurface
from compas_pattern.algorithms.relaxation.constraints import automated_smoothing_constraints

polygonal_mesh = copy.deepcopy(polygonal_mesh)

constrained_mesh = polygonal_mesh.copy()

constraints = automated_smoothing_constraints(constrained_mesh, points, curves)

object_constraints = curves + points

for key, object in constraints.items():
    constraints[key] = object_constraints.index(object)

vertex_constraints = list(constraints.items())
# ---------- end python_4 ----------
python_5 = PythonScript(
    constrained_mesh=python_4.constrained_mesh,
    kmax=kmax,
    damping=damping,
    vertex_constraints=python_4.vertex_constraints,
    object_constraints=python_4.object_constraints)  # -> out, smooth_mesh; inputs kmax: Int32, vertex_constraints: list, object_constraints: list
# ---------- python_5: Python ----------
import copy

from compas_pattern.algorithms.relaxation.relaxation import constrained_smoothing

constrained_mesh = copy.deepcopy(constrained_mesh)

smooth_mesh = constrained_mesh.copy()

vertex_constraints = {key_object[0]: object_constraints[key_object[1]] for key_object in vertex_constraints}

constrained_smoothing(smooth_mesh, kmax, damping, vertex_constraints, algorithm = 'area')
# ---------- end python_5 ----------

# ----
# compas_pattern data structure
# to Rhino mesh
python_6 = PythonScript(smooth_mesh=python_5.smooth_mesh)  # -> out, guids
# ---------- python_6: Python ----------
import copy

from compas_pattern.cad.rhino.draw import draw_mesh

smooth_mesh = copy.deepcopy(smooth_mesh)

guids = draw_mesh(smooth_mesh, group = False)
# ---------- end python_6 ----------

geo = Geometry(python_6.guids)
