# Grasshopper definition singular_feature_exploration.gh (Grasshopper 0.9.76)
# plug-ins: Python Interpreter

# ----
# singular GH
# singular feature exploration
# by Robin OVAL
# from compas_pattern
# https://github.com/BlockResearchGroup/compas_pattern
# SURFACE
# POINT FEATURES
srf = Surface(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)
pt = Point([Point(26.38112054, 16.02785074, 5.787169855), Point(6.46224635, 20.00084667, -0.1341664208)])

# ----
# DECOMPOSITION
number_slider = Slider(2, range=0..5)
python = PythonScript(surface=srf, points=pt, precision=number_slider)  # -> out, coarse_quad_mesh; inputs points: list
# ---------- python: Python ----------
import rhinoscriptsyntax as rs
import Rhino
import scriptcontext as sc
from compas_pattern.cad.rhino.objects.surface import RhinoSurface
from compas_pattern.cad.rhino.objects.curve import RhinoCurve
#sc.doc = Rhino.RhinoDoc.ActiveDoc
sc.doc = ghdoc

id = sc.doc.Objects.Find(surface)
print(id)
srf = RhinoSurface.from_guid(surface)
print(srf)
print(rs.ObjectType(srf.guid))
curves = srf.borders()
print(curves[0])

crv_id = RhinoCurve.from_guid(curves[0])

from compas_pattern.algorithms.decomposition.algorithm import surface_decomposition
from compas_pattern.algorithms.decomposition.algorithm import decomposition_mesh

#decomposition, outer_boundary, inner_boundaries, polyline_features, point_features = surface_decomposition(surface, precision, pt_guids = points)
#coarse_quad_mesh = decomposition_mesh(surface, decomposition, point_features)
#coarse_quad_mesh.collect_strips()
#coarse_quad_mesh.set_strips_density(1)
# ---------- end python ----------

# ----
# DENSITY
number_slider_2 = Slider(2, range=0..5)
python_2 = PythonScript(coarse_quad_mesh=python.coarse_quad_mesh, density_target=number_slider_2)  # -> out, quad_mesh
# ---------- python_2: Python ----------
coarse_quad_mesh.set_strips_density_target(density_target)
coarse_quad_mesh.densification()
quad_mesh = coarse_quad_mesh.get_quad_mesh()
# ---------- end python_2 ----------

kmax = Slider(20, range=0..100)
damping = Slider(0.5, range=0..1)

# ----
# GEOMETRY
# smooth quad mesh
# with constraints
# apply constraints
python_3 = PythonScript(polygonal_mesh=python_2.quad_mesh, surface=srf, points=pt)  # -> out, constrained_mesh, vertex_constraints, object_constraints; inputs points: list
# ---------- python_3: Python ----------
import rhinoscriptsyntax as rs
from compas_pattern.cad.rhino.objects.surface import RhinoSurface
from compas_pattern.datastructures.mesh.constraints import automated_smoothing_constraints

constrained_mesh = polygonal_mesh.copy()

points += [rs.AddPoint(point) for point in RhinoSurface(surface).kinks()]
curves = RhinoSurface(surface).borders(type = 0)

constraints = automated_smoothing_constraints(constrained_mesh, points, curves, surface)

object_constraints = [surface] + curves + points

for key, object in constraints.items():
    constraints[key] = object_constraints.index(object)

vertex_constraints = list(constraints.items())
# ---------- end python_3 ----------
python_4 = PythonScript(
    constrained_mesh=python_3.constrained_mesh,
    kmax=kmax,
    damping=damping,
    vertex_constraints=python_3.vertex_constraints,
    object_constraints=python_3.object_constraints)  # -> out, smooth_mesh; inputs kmax: Int32, vertex_constraints: list, object_constraints: list
# ---------- python_4: Python ----------
from compas_pattern.datastructures.mesh.relaxation import constrained_smoothing

smooth_mesh = constrained_mesh.copy()

vertex_constraints = {key_object[0]: object_constraints[key_object[1]] for key_object in vertex_constraints}

constrained_smoothing(smooth_mesh, kmax, damping, vertex_constraints, algorithm = 'area')
# ---------- end python_4 ----------

# ----
# compas objects
# to Rhino objects
python_5 = PythonScript(smooth_mesh=python_4.smooth_mesh)  # -> out, mesh
# ---------- python_5: Python ----------
import rhinoscriptsyntax as rs

vertices, faces = smooth_mesh.to_vertices_and_faces()
mesh = rs.AddMesh(vertices.values(), faces.values())
# ---------- end python_5 ----------
python_6 = PythonScript(smooth_mesh=python_4.smooth_mesh)  # -> out, polylines
# ---------- python_6: Python ----------
import rhinoscriptsyntax as rs

smooth_mesh.collect_polyedges()
polylines = [rs.AddPolyline(polyline) for polyline in smooth_mesh.polylines()]
# ---------- end python_6 ----------

crv = Curve(python_6.polylines)
mesh = Mesh(python_5.mesh)
