# Grasshopper definition compas_pattern_grasshopper.gh (Grasshopper 0.9.76)
# plug-ins: Python Interpreter

srf = Surface(<surface referenced from the Rhino model>)
mesh = Mesh(<mesh referenced from the Rhino model>)

# ----
# from quad mesh
# to coarse quad mesh
# from surface
# to coarse quad mesh
number_slider = Slider(0.2, range=0..1)
# INPUT DATA
python_script = PythonScript(mesh_guid=mesh)  # -> out, coarse_quad_mesh
# ---------- python_script: Python ----------
from compas_rhino.geometry import RhinoMesh
from compas_pattern.datastructures.mesh_quad import QuadMesh
from compas_pattern.datastructures.mesh_quad_coarse import CoarseQuadMesh

coarse_quad_mesh = CoarseQuadMesh.from_quad_mesh(QuadMesh.from_vertices_and_faces(*RhinoMesh.from_guid(mesh_guid).get_vertices_and_faces()))
# ---------- end python_script ----------
python = PythonScript(surface=srf, precision=number_slider)  # -> out, coarse_quad_mesh
# ---------- python: Python ----------
from compas_pattern.algorithms.skeletonisation import surface_skeleton_decomposition_mesh

coarse_quad_mesh = surface_skeleton_decomposition_mesh(surface, precision)
# ---------- end python ----------

# ----
# TOPOLOGY
# strip data
# delete strips
python_2 = PythonScript(coarse_quad_mesh=python_script.coarse_quad_mesh)  # -> out, strip_polylines
# ---------- python_2: Python ----------
import rhinoscriptsyntax as rs

strip_polylines = [rs.AddPolyline(coarse_quad_mesh.strip_edge_polyline(skey)) for skey in coarse_quad_mesh.strips()]
# ---------- end python_2 ----------
genes = GenePool(Decimals=0, Maximum=1, Minimum=0, Value=[0, 0, 0, 0, 0, 0, 0.4885265866, 0, 0, 0, 0, 0, 0, 0, 0.5, 0.5, 0.5, 0.5])
python_3 = PythonScript(coarse_quad_mesh=python_script.coarse_quad_mesh, strip_booleans=genes)  # -> out, trimmed_coarse_quad_mesh; inputs strip_booleans: list of Boolean
# ---------- python_3: Python ----------
from compas_pattern.topology.grammar import delete_strips
from compas_pattern.topology.grammar import split_strip
from compas_pattern.topology.grammar import strips_to_split_to_preserve_boundaries_before_deleting_strips

strips = {i: skey for i, skey in enumerate(coarse_quad_mesh.strips())}
skeys = [skey for i, skey in enumerate(strips) if strip_booleans[i]]

trimmed_coarse_quad_mesh = coarse_quad_mesh.copy()
trimmed_coarse_quad_mesh.init_strip_density()

to_split = strips_to_split_to_preserve_boundaries_before_deleting_strips(trimmed_coarse_quad_mesh, skeys)
for skey, n in to_split.items():
    skey_1, skey_2 = split_strip(trimmed_coarse_quad_mesh, skey)
    d = int(math.ceil(float(trimmed_coarse_quad_mesh.get_strip_density(skey)) / 2.))
    trimmed_coarse_quad_mesh.set_strip_density(skey_1, d)
    trimmed_coarse_quad_mesh.set_strip_density(skey_2, d)
delete_strips(trimmed_coarse_quad_mesh, skeys)
# ---------- end python_3 ----------
lng = ListLength(List=python_2.strip_polylines)
number_of_strips = Panel(lng)

# ----
# global density target
# local density values
number_slider_2 = Slider(0.5, range=0..2)
genes_2 = GenePool(
    Decimals=0,
    Maximum=10,
    Minimum=1,
    Value=[5.602938469, 4, 5.929134929, 3.622746848, 1.971227642, 3, 3, 4, 10, 4, 1, 4, 2, 3.950256811, 4.368376244, 6, 7.289465084, 1])
# DENSITY
python_4 = PythonScript(trimmed_coarse_quad_mesh=python_3.trimmed_coarse_quad_mesh, density_target=number_slider_2)  # -> out, quad_mesh
# ---------- python_4: Python ----------
trimmed_coarse_quad_mesh.set_strips_density_target(density_target)
trimmed_coarse_quad_mesh.densification()
quad_mesh = trimmed_coarse_quad_mesh.quad_mesh
# ---------- end python_4 ----------
python_5 = PythonScript(trimmed_coarse_quad_mesh=python_3.trimmed_coarse_quad_mesh, density_values=genes_2)  # -> out, quad_mesh; inputs density_values: list of Int32
# ---------- python_5: Python ----------
for i, skey in enumerate(trimmed_coarse_quad_mesh.strips()):
    trimmed_coarse_quad_mesh.set_strip_density(skey, density_values[i])
trimmed_coarse_quad_mesh.densification()
quad_mesh = trimmed_coarse_quad_mesh.quad_mesh
# ---------- end python_5 ----------

pt = Point([<point referenced from the Rhino model> x7])
srf_2 = Surface(<surface referenced from the Rhino model>)
crv = Curve([<curve referenced from the Rhino model> x3])

kmax = Slider(30, range=0..100)
damping = Slider(0.5, range=0..1)

# ----
# GEOMETRY - SMOOTHING
# smooth quad mesh
# with constraints
# apply constraints
python_6 = PythonScript(quad_mesh=python_4.quad_mesh, points=pt, curves=crv, surface=srf_2)  # -> out, constrained_quad_mesh, vertex_constraints, object_constraints; inputs points: list, curves: list
# ---------- python_6: Python ----------
import rhinoscriptsyntax as rs

from compas_pattern.utilities.lists import list_split
from compas.geometry import closest_point_in_cloud
from compas.geometry import distance_point_point

from compas_rhino.geometry.curve import RhinoCurve

constrained_quad_mesh = quad_mesh.copy()

constraints = {}

if surface is not None:
    constraints.update({vkey: surface for vkey in constrained_quad_mesh.vertices()})

if curves is not None:
    for vkey in constrained_quad_mesh.vertices_on_boundary():
        xyz = constrained_quad_mesh.vertex_coordinates(vkey)
        projections = {curve: distance_point_point(xyz, RhinoCurve(curve).closest_point(xyz)) for curve in curves}
        constraints.update({vkey: min(projections, key = projections.get)})

if points is not None:
    key_to_index = {i: vkey for i, vkey in enumerate(constrained_quad_mesh.vertices())}
    vertex_coordinates = tuple(constrained_quad_mesh.vertex_coordinates(vkey) for vkey in constrained_quad_mesh.vertices())
    constraints.update({key_to_index[closest_point_in_cloud(rs.PointCoordinates(point), vertex_coordinates)[2]]: point for point in points})



object_constraints = [surface] + curves + points

for key, object in constraints.items():
    constraints[key] = object_constraints.index(object)

vertex_constraints = list(constraints.items())
# ---------- end python_6 ----------
python_7 = PythonScript(
    constrained_quad_mesh=python_6.constrained_quad_mesh,
    kmax=kmax,
    damping=damping,
    vertex_constraints=python_6.vertex_constraints,
    object_constraints=python_6.object_constraints)  # -> out, smooth_quad_mesh; inputs kmax: Int32, vertex_constraints: list, object_constraints: list
# ---------- python_7: Python ----------
from compas_pattern.algorithms.smoothing import constrained_smoothing

smooth_quad_mesh = constrained_quad_mesh.copy()

vertex_constraints = {key_object[0]: object_constraints[key_object[1]] for key_object in vertex_constraints}

constrained_smoothing(smooth_quad_mesh, kmax, damping, vertex_constraints, algorithm = 'area')
# ---------- end python_7 ----------

# ----
# Conway operators
list = ValueList({"dual", "join", "ambo", "kis", "needle", "zip", "truncate", "ortho", "expand", "gyro", "snub", "meta", "bevel"}, selected="gyro")
# SYMMETRY
python_8 = PythonScript(seed_mesh=python_7.smooth_quad_mesh, operator=list)  # -> out, polygonal_mesh
# ---------- python_8: Python ----------
from compas.topology.conway import *

conway_operators = {'dual': conway_dual, 'join': conway_join, 'ambo': conway_ambo, 'kis': conway_kis, 'needle': conway_needle, 'zip': conway_zip, 'truncate': conway_truncate, 'ortho': conway_ortho, 'expand': conway_expand, 'gyro': conway_gyro, 'snub': conway_snub, 'meta': conway_meta, 'bevel': conway_bevel}

polygonal_mesh = conway_operators[operator](seed_mesh.copy())
# ---------- end python_8 ----------

# ----
# from quad mesh
# to quad mesh guid
# from polygonal mesh
# to line guids
python_9 = PythonScript(polygonal_mesh_datastructure=python_8.polygonal_mesh)  # -> out, guids
# ---------- python_9: Python ----------
from compas_pattern.cad.rhino.utilities import draw_mesh

guids = draw_mesh(polygonal_mesh_datastructure, group = False)
# ---------- end python_9 ----------
# OUTPUT DATA
python_10 = PythonScript(quad_mesh_datastructure=python_7.smooth_quad_mesh)  # -> out, guid
# ---------- python_10: Python ----------
from compas_pattern.cad.rhino.utilities import draw_mesh

guid = draw_mesh(quad_mesh_datastructure, group = False)
# ---------- end python_10 ----------

mesh_2 = Mesh(python_10.guid)
geo = Geometry(python_9.guids)
