# Grasshopper definition kagome_190425.gh (Grasshopper 0.9.76)
# plug-ins: MeshEdit Components, Python Interpreter, GH_MinSurf, LunchBox, Weaverbird, Kangaroo2 Components, IntraLattice

# ----
# From surface
srf = Surface(<surface referenced from the Rhino model>)
mesh_uv = MeshSurface(Surface=srf, UCount=1, VCount=1, Overhang=True, Equalize=False)
tri = Triangulate(Mesh=mesh_uv)  # -> Mesh, Count
mesh = Mesh(tri.Mesh)

# ----
# From skeleton
crv = Curve([<curve referenced from the Rhino model> x4])
weaving = PythonScript(lines=crv)  # -> out, coarse_node_tri_mesh; inputs lines: list
# ---------- weaving: Python ----------
import rhinoscriptsyntax as rs
from compas.utilities import average
from compas_pattern.datastructures.kagome.kagome import Kagome
from compas_pattern.cad.rhino.draw import draw_mesh

size = average([rs.CurveLength(line) for line in lines]) / 2
lines = [(rs.CurveStartPoint(line), rs.CurveEndPoint(line)) for line in lines]
mesh = Kagome.from_skeleton(lines, size)
coarse_node_tri_mesh = draw_mesh(mesh)
# ---------- end weaving ----------
mesh_2 = Mesh(weaving.coarse_node_tri_mesh)

# ----
# From lines
crv_2 = Curve([<curve referenced from the Rhino model> x14])
wbweave = WeaverbirdsMeshFromLinesWeaveBack(Lines=crv_2, MaximumValence=4)
mesh_3 = Mesh(wbweave)

# ----
# INPUT
# From mesh
mesh_4 = Mesh(<mesh referenced from the Rhino model>)

# ----
# From points
pt = Point([<point referenced from the Rhino model> x9])
del = DelaunayMesh(Points=pt, Plane=PlaneXY(0, 0, 0))
mesh_5 = Mesh(del)

enneper = EnneperSurface(UDivisions=100, VDivisions=100, RParameter=3, Scale=15, Domain1=Domain(0, 1), Domain2=Domain(-3.141592654, 3.141592654))
mesh_uv_2 = MeshSurface(Surface=enneper, UCount=Slider(6, range=0..100), VCount=Slider(18, range=0..100), Overhang=True, Equalize=False)
weldvertices = MeshWeldVertices(Mesh=mesh_uv_2, Tolerance=0.01)  # -> RuntimeMessage, Mesh
diag = Diagonalize(Mesh=weldvertices.Mesh)
tri_2 = Triangulate(Mesh=weldvertices.Mesh)  # -> Mesh, Count
wbjoin = WeaverbirdsJoinMeshesAndWeld(Mesh=tri_2.Mesh, Weld=False)
medges = MeshEdges(Mesh=tri_2.Mesh)  # -> NakedEdges, InteriorEdges, NonManifoldEdges

# ----
# Generate Kagome weaving pattern from mesh
density = Slider(2, range=0..10)
# PATTERNING
mesh_6 = Mesh(mesh_4)
weaving_2 = PythonScript(coarse_tri_mesh=mesh_6, density=density)  # -> out, pattern
# ---------- weaving_2: Python ----------
from compas_rhino.geometry import RhinoMesh
from compas_pattern.datastructures.kagome.kagome import Kagome
from compas.datastructures import mesh_weld

pattern = Kagome.from_vertices_and_faces(*RhinoMesh.from_guid(coarse_tri_mesh).get_vertices_and_faces())
pattern.densification(int(density))
pattern.dense_mesh = mesh_weld(pattern.dense_mesh)
pattern.patterning()
pattern.store_kagome_polyedge_data()
# ---------- end weaving_2 ----------

python = PythonScript(mesh=wbjoin)  # -> out, mesh
# ---------- python: Python ----------
from compas.datastructures import mesh_weld
import rhinoscriptsyntax as rs
from compas_rhino.geometry import RhinoMesh
from compas_pattern.datastructures.mesh.mesh import Mesh


mesh = Mesh.from_vertices_and_faces(*RhinoMesh.from_guid(mesh).get_vertices_and_faces())
mesh = mesh_weld(mesh)
vertices, faces = mesh.to_vertices_and_faces()
mesh = rs.AddMesh(vertices.values(), faces.values())
# ---------- end python ----------
wbnaked = WeaverbirdsNakedBoundary(MeshClosedPolylines=tri_2.Mesh)
thickness = Slider(0.1, range=0..0.2)
width = Slider(0.2, range=0..0.5)
mobius = MobiusSurface(
    UDivisions=100,
    VDivisions=100,
    RParameter=4,
    TParameter=0.5,
    Scale=5,
    Domain1=Domain(-3.141592654, 3.141592654),
    Domain2=Domain(-1, 1))
mesh_7 = Mesh(<mesh referenced from the Rhino model>)
klein = KleinSurface(
    UDivisions=96,
    VDivisions=91,
    RParameter=3,
    TParameter=0.5,
    Scale=5,
    Domain1=Domain(0, 12.56637061),
    Domain2=Domain(0, 3.141592654))
diag_2 = Diagonalize(Mesh=mesh_7)
_3dsupershape = _3DSupershape(
    UDivisions=80,
    VDivisions=80,
    MParameter=14.074,
    AParameter=-0.06,
    BParameter=2.75,
    N1Parameter=3.75,
    N2Parameter=-0.48,
    N3Parameter=1.46,
    ScaleParameter=10,
    D1Interval=Domain(-3.141592654, 3.141592654),
    D2Interval=Domain(-1.570796327, 1.570796327))
weldvertices_2 = MeshWeldVertices(Mesh=diag_2, Tolerance=0.01)  # -> RuntimeMessage, Mesh
torus = TorusSurface(
    UDivisions=90,
    VDivisions=96,
    CParameter=4,
    RParameter=2,
    TParameter=1,
    Scale=5,
    Domain1=Domain(0, 6.283185307),
    Domain2=Domain(-3.141592654, 3.141592654))
tri_3 = Triangulate(Mesh=weldvertices_2.Mesh)  # -> Mesh, Count
weldvertices_3 = MeshWeldVertices(Mesh=tri_3.Mesh, Tolerance=0.01)  # -> RuntimeMessage, Mesh
medges_2 = MeshEdges(Mesh=tri_3.Mesh)  # -> NakedEdges, InteriorEdges, NonManifoldEdges

# ----
# Kagome
data = Data(weaving_2.pattern)

number_slider = Slider(5, range=0..10)
helicoid = HelicoidSurface(
    UDivisions=100,
    VDivisions=100,
    RParameter=2,
    TParameter=1,
    Scale=5,
    Domain1=Domain(-6.283185307, 6.283185307),
    Domain2=Domain(-3.141592654, 3.141592654))
paraboloid = HyperbolicParaboloid(U=100, V=100, a=2, b=2, S=5, D1=Domain(-4, 4), D2=Domain(-4, 4))
mesh_uv_3 = MeshSurface(Surface=paraboloid, UCount=Slider(7, range=0..100), VCount=Slider(10, range=0..100), Overhang=True, Equalize=False)
geo = Geometry(<curve referenced from the Rhino model>)
geo_2 = Geometry(<curve referenced from the Rhino model>)
geo_3 = Geometry(<curve referenced from the Rhino model>)
geo_4 = Geometry(<curve referenced from the Rhino model>)
conoid = ConoidSurface(
    UDivisions=100,
    VDivisions=100,
    RParameter=7,
    TParameter=1,
    Scale=5,
    Domain1=Domain(-4.838052687, 4.838052687),
    Domain2=Domain(-1.570796327, 1.570796327))
number_slider_2 = Slider(10, range=0..10)
minsurf_2c = MinimalSurface(C0Curve=geo_4, C1Curve=geo_2, UCount=20, VCount=20, Itteration=20, SurfaceUDegree=3, SurfaceVDegree=3)  # -> UVPointGrid, ResultingSurface
platotetra = PlatonicTetrahedron(Plane=PlaneXY(0, 0, 0), Radius=10, Truncation=0)

# ----
# DATA
# Kagome strip polylines
weaving_3 = PythonScript(pattern=data)  # -> out, strip_polylines
# ---------- weaving_3: Python ----------
import rhinoscriptsyntax as rs
from Grasshopper.Kernel.Data import GH_Path
from Grasshopper import DataTree

strip_polylines = DataTree[object]()
for i, polyline in enumerate(pattern.kagome_polylines()):
    for j, point in enumerate(polyline):
        path = GH_Path(i, j)
        strip_polylines.Add(rs.AddPoint(point), path)
# ---------- end weaving_3 ----------

# ----
# Kagome strip frames
weaving_4 = PythonScript(pattern=data)  # -> out, strip_frames
# ---------- weaving_4: Python ----------
import rhinoscriptsyntax as rs
from Grasshopper.Kernel.Data import GH_Path
from Grasshopper import DataTree

strip_frames = DataTree[object]()
for i, polyline in enumerate(pattern.kagome_polyline_frames()):
    for j, frame in enumerate(polyline):
       path = GH_Path(i, j)
       strip_frames.AddRange([rs.AddPoint(vector) for vector in frame], path)
# ---------- end weaving_4 ----------

# ----
# Kagome strip weaving
weaving_5 = PythonScript(pattern=data)  # -> out, strip_directions
# ---------- weaving_5: Python ----------
import rhinoscriptsyntax as rs
from Grasshopper.Kernel.Data import GH_Path
from Grasshopper import DataTree

strip_directions = DataTree[object]()
for i, polyline in enumerate(pattern.kagome_polyedge_weaving()):
    for j, direction in enumerate(polyline):
       path = GH_Path(i, j)
       strip_directions.Add(direction, path)
# ---------- end weaving_5 ----------

# ----
# Kagome strip colours
weaving_6 = PythonScript(pattern=data)  # -> out, strip_colours
# ---------- weaving_6: Python ----------
import rhinoscriptsyntax as rs
from Grasshopper.Kernel.Data import GH_Path
from Grasshopper import DataTree

polyline_colour = pattern.kagome_polyedge_colouring_2()

strip_colours = DataTree[object]()
for i, colour in enumerate(polyline_colour):
    strip_colours.Add(colour, GH_Path(i))
# ---------- end weaving_6 ----------

# ----
# Kagome strip boundary
weaving_7 = PythonScript(pattern=data)  # -> out, strip_boundary
# ---------- weaving_7: Python ----------
import rhinoscriptsyntax as rs
from Grasshopper.Kernel.Data import GH_Path
from Grasshopper import DataTree

strip_boundary = DataTree[object]()
for i, polyedge in enumerate(pattern.kagome_polyedge_data):
    if pattern.kagome.is_edge_on_boundary(*polyedge[:2]):
        is_boundary = True
    else:
        is_boundary = False
    path = GH_Path(i)
    strip_boundary.Add(is_boundary, path)
# ---------- end weaving_7 ----------

# ----
# Kagome singularities
weaving_8 = PythonScript(pattern=data)  # -> out, singular_faces
# ---------- weaving_8: Python ----------
import rhinoscriptsyntax as rs

#singular_faces = pattern.kagome_singularities()
print pattern.kagome_singularities()
singular_faces = [rs.AddPolyline(polyline) for polyline in pattern.kagome_singularities()]
#singularities = [rs.AddPoint(point) for point in pattern.singularity_points()]
# ---------- end weaving_8 ----------
crv_3 = Curve(weaving_8.singular_faces)

# ----
# Triangular mesh
weaving_9 = PythonScript(pattern=data)  # -> out, triangulated_mesh
# ---------- weaving_9: Python ----------
import rhinoscriptsyntax as rs

vertices, faces = pattern.dense_mesh.to_vertices_and_faces()
triangulated_mesh = rs.AddMesh(vertices.values(), faces.values())
# ---------- end weaving_9 ----------
mesh_8 = Mesh(weaving_9.triangulated_mesh)

minsrf_4c_mesh = MinimalSurfaceMesh(UCount=20, VCount=20, Itteration=20)  # -> UVPointGrid, ResultingMesh
number_slider_3 = Slider(1, range=0..10)
list = ValueList({"Grid": 0, "X": 1, "Star": 2, "Cross": 3, "Tesseract": 4, "Vintiles": 5, "Octet": 6}, selected="Vintiles")
minsurf_2c_mesh = MinimalSurfaceMesh(
    C0Curve=<geometry referenced from the Rhino model>,
    C1Curve=<geometry referenced from the Rhino model>,
    UCount=number_slider,
    VCount=number_slider,
    Itteration=20)  # -> UVPointGrid, ResultingSurface
mesh_9 = MeshBrep(
    Brep=platotetra,
    Settings={GridMaxCount=0, GridMinCount=16, JaggedSeams=False, MaxEdgeLength=0, MinEdgeLength=0.0001, MinTolerance=0, Refine=True, RefineAngle=0, RelativeTolerance=0.65, SimplePlanes=True, Tolerance=0})
minsrf_4c_mesh_2 = MinimalSurfaceMesh(U0Curve=geo_4, U1Curve=geo_2, V0Curve=geo, V1Curve=geo_3, UCount=number_slider_2, VCount=number_slider_2, Itteration=20)  # -> UVPointGrid, ResultingMesh
weldvertices_4 = MeshWeldVertices(Mesh=minsrf_4c_mesh_2.ResultingMesh, Tolerance=0.01)  # -> RuntimeMessage, Mesh
customcell = CustomCell()
presetcell = PresetCell(CellTye=list)
medges_3 = MeshEdges(Mesh=minsrf_4c_mesh_2.ResultingMesh)  # -> NakedEdges, InteriorEdges, NonManifoldEdges
basicbox = BasicBox(
    Topology=presetcell,
    CellSizeX=5,
    CellSizeY=5,
    CellSizeZ=5,
    NumberOfCellsX=number_slider_3,
    NumberOfCellsY=number_slider_3,
    NumberOfCellsZ=number_slider_3)
meshpreview = MeshPreview()

# ----
# PROCESSING
# Build polylines
trim = TrimTree(Tree=weaving_3.strip_polylines, Depth=1)
pline = PolyLine(Vertices=trim, Closed=False)
crv_4 = Curve(pline)

homogen = Homogen(Struts=basicbox, Radius=Slider(0.4, range=0..1))

# ----
# Offset polylines for weaving
item = ListItem(List=weaving_4.strip_frames, Index=0, Wrap=True)
trim_2 = TrimTree(Tree=weaving_5.strip_directions, Depth=1)
trim_3 = TrimTree(Tree=weaving_3.strip_polylines, Depth=1)
trim_4 = TrimTree(Tree=item, Depth=1)
multiplication = Multiplication(A=trim_2, B=thickness)
lng = ListLength(List=trim_4)
num = Number(multiplication)
repeat = RepeatData(Data=num, Length=lng)
multiplication_2 = Multiplication(A=trim_4, B=repeat)
move = Move(Geometry=trim_3, Motion=multiplication_2)  # -> simplify(graft(Geometry)), Transform

medges_4 = MeshEdges(Mesh=homogen)  # -> NakedEdges, InteriorEdges, NonManifoldEdges
data_2 = Data(move.Geometry)

# ----
# Build strips
item_2 = ListItem(List=weaving_4.strip_frames, Index=2, Wrap=True)
division = Division(A=width, B=2)
multiplication_3 = Multiplication(A=division, B=-1)
multiplication_4 = Multiplication(A=item_2, B=[multiplication_3, division])
move_2 = Move(Geometry=data_2, Motion=multiplication_4)  # -> Geometry, Transform
item_3 = ListItem(List=move_2.Geometry, Index=0, Wrap=True)  # -> Item, Item1
ln = Line(StartPoint=item_3.Item, EndPoint=item_3.Item1)
trim_5 = TrimTree(Tree=ln, Depth=1)
lng_2 = ListLength(List=trim_5)
subtraction = Subtraction(A=lng_2, B=1)
split = SplitList(List=trim_5, Index=subtraction)  # -> simplify(ListA), ListB
shift = ShiftList(List=trim_5, Shift=1, Wrap=False)  # -> simplify(List)
end = EndPoints(Curve=split.ListA)  # -> graft(Start), graft(End)
end_2 = EndPoints(Curve=shift)  # -> graft(Start), graft(End)
merge = Merge(Data1=end.Start, Data2=end.End, Data3=end_2.End, Data4=end_2.Start)
conmesh = ConstructMesh(Vertices=merge, Faces={A=0, B=1, C=2, D=3})
trim_6 = TrimTree(Tree=conmesh, Depth=1)
mjoin = MeshJoin(Meshes=trim_6)
weldvertices_5 = MeshWeldVertices(Mesh=mjoin, Tolerance=0.01)  # -> RuntimeMessage, Mesh
mesh_10 = Mesh(flatten(weldvertices_5.Mesh))

# ----
# Smooth strips
number_slider_4 = Slider(3, range=0..10)
division_2 = Division(A=thickness, B=3)
wbcatmullclark = WeaverbirdsCatmullClarkSubdivision(MeshCurves=mesh_10, Level=number_slider_4, SmoothNakedEdges=1)  # -> flatten(OutputMeshCurves)
toggle = BooleanToggle(True)
m_offset_extrude = MeshOffsetExtrude(M=wbcatmullclark, B=toggle, E=toggle, C0=toggle, C1=toggle, D=division_2)  # -> out, A; inputs M: Mesh, V: list of Vector3d, D: list
# ---------- m_offset_extrude: VB ----------
    Component.Params.Input(0).Name = "Mesh"
    Component.Params.Input(0).Description = "Open or closed mesh"
    Component.Params.Input(1).Name = "Both Sides"
    Component.Params.Input(1).Description = "If true the mesh is offset in both directions along the vertex normals"
    Component.Params.Input(2).Name = "Edges"
    Component.Params.Input(2).Description = "If true the mesh will contain faces on the edges between the two offset mesh faces"
    Component.Params.Input(3).Name = "Closed Bottom"
    Component.Params.Input(3).Description = "If true the mesh will be closed on the origin face"
    Component.Params.Input(4).Name = "Closed Top"
    Component.Params.Input(4).Description = "If true the mesh will be closed on the offset face"
    Component.Params.Input(5).Name = "Vector [Vertex]"
    Component.Params.Input(5).Description = "An optional vector that sets the direction of extrusion, if empty, the new mesh will be offset along the vertex normals"
    Component.Params.Input(6).Name = "Distance [Vertex, Rh Units]"
    Component.Params.Input(6).Description = "A single number or list of numbers corresponding to each vertex of a mesh which sets the Rhino unit based distance that the new geometry is offset from each mesh face"

    Component.Params.Output(1).Name = "Mesh"
    Component.Params.Output(1).Description = "If successful, a valid mesh"

    If m IsNot Nothing Then

      Dim mf As Rhino.Geometry.Collections.MeshFaceList = Nothing
      Dim mv As Rhino.Geometry.Collections.MeshVertexList = Nothing
      Dim mtv As Rhino.Geometry.Collections.MeshTopologyVertexList = Nothing
      Dim mte As Rhino.Geometry.Collections.MeshTopologyEdgeList = Nothing
      Dim mn As Rhino.Geometry.Collections.MeshVertexNormalList = Nothing
      Dim mc As Rhino.Geometry.Collections.MeshVertexColorList = Nothing

      mf = m.Faces
      mv = m.Vertices
      mtv = m.TopologyVertices
      mte = m.TopologyEdges
      mn = m.Normals
      mc = m.VertexColors

      Dim clrB As Boolean = False
      If mc.count() > 0 Then clrB = True

      Dim i,cv,cf,u(1),hd As Integer
      Dim blnV As Boolean
      Dim vec As vector3d
      Dim ova, ovb As New list(Of point3d)
      Dim vf As New list(Of Vector3f)
      Dim ofc As New list(Of MeshFace)
      If b Then hd = 2 Else hd = 1
      
      cv = mv.count()
      cf = mf.count()

      If (D.count() - 1) < cv Then D = matchDbl(D, cv)

      If v.count() > 0 Then
        blnV = True
        If (V.count() - 1) < cv Then V = matchVec(V, cv)
      End If

      'Define Base Vertices
      For i = 0 To cv - 1 Step 1
        If blnV Then vec = V(i) Else vec = mn(i)
        vec.Unitize()
        vec *= (D(i) / hd)

        ovb.add(New point3d(mv(i)) + vec)
        If Not b Then vec *= 0
        vec.Reverse()
        ova.add(New point3d(mv(i)) + vec)
      Next

      If (c0 Or (((Not c0) And (Not e)) And c1)) Then ofc = mf.ToList()

      If ((e or c0) And c1) Then
        For i = 0 To cf - 1 Step 1
          If mf(i).isquad() Then
            ofc.add(New meshface(mf(i).A + cv, mf(i).B + cv, mf(i).C + cv, mf(i).D + cv))
          Else
            ofc.add(New meshface(mf(i).A + cv, mf(i).B + cv, mf(i).C + cv))
          End If
        Next
      End If

      If e Then
        For i = 0 To mte.count() - 1 Step 1

          u(0) = mtv.MeshVertexIndices(mte.GetTopologyVertices(i).I)(0)
          u(1) = mtv.MeshVertexIndices(mte.GetTopologyVertices(i).J)(0)

          If uBound(mte.GetConnectedFaces(i)) < 1 Then
            ofc.add(New meshface(u(0), u(1), u(1) + cv, u(0) + cv))
          End If
        Next
      End If

      Dim mo As New mesh

      If (c0 Or e) Then
        mo.Vertices.AddVertices(ova.toarray())
        If clrB Then mo.VertexColors.AppendColors(mc.ToArray())
      End If
      If (c1 Or e) Then
        mo.Vertices.AddVertices(ovb.toarray())
        If clrB Then mo.VertexColors.AppendColors(mc.ToArray())
      End If

      mo.Faces.AddFaces(ofc)

      A = mo
    End If
# ---------- m_offset_extrude: VB additional code ----------
  Private Function matchDbl(ByVal a As list(Of Double), ByVal t As Integer)
    Dim i,k As Integer
    k = a.count()
    For i = 0 To ((t + 1) - k) - 1 Step 1
      a.add(a.item(k - 1))
    Next
    Return a
  End Function

  Private Function matchVec(ByVal a As list(Of vector3d), ByVal t As Integer)
    Dim i,k As Integer
    k = a.count()
    For i = 0 To ((t + 1) - k) - 1 Step 1
      a.add(a.item(k - 1))
    Next
    Return a
  End Function
# ---------- end m_offset_extrude ----------
unifynormals = MeshUnifyNormals(Mesh=m_offset_extrude.A)

# ----
# Colour strips
bnd = Bounds(Numbers=flatten(weaving_6.strip_colours))
dedomain = DeconstructDomain(Domain=bnd)  # -> Start, End
gradient = Gradient(
    LowerLimit=dedomain.Start,
    UpperLimit=dedomain.End,
    Parameter=weaving_6.strip_colours,
    stops=[0: RGB(234, 38, 0), 0.25: RGB(234, 126, 0), 0.5: RGB(254, 244, 84), 0.75: RGB(173, 203, 249), 1: RGB(75, 107, 169)])
preview = CustomPreview(Geometry=graft(unifynormals), Shader=gradient)

# ----
# Bake strips per group with colour in layers
panel = Panel("strip_group_")
txt = Text(flatten(weaving_6.strip_colours))
concat = Concatenate(FragmentA=panel, FragmentB=txt)
bake = ObjectBake(
    BakeToggle=Button(),
    GeometryObjects=unifynormals,
    Layer=concat,
    ObjectName="GH_Obj",
    ObjectColor=flatten(gradient),
    LayerColor=RGB(255, 255, 255))
